# Grasshopper definition G-code_Slicer.gh (Grasshopper 1.0.7)
# plug-ins: Pufferfish

crv = Curve([<curve referenced from the Rhino model> x4])
srf = Surface(<surface referenced from the Rhino model>)
crv_2 = Curve(<curve referenced from the Rhino model>)
paramptonsrf = ParameterPointOnSurface(Surface=srf, ParameterU=Slider(0.7, range=0..1), ParameterV=Slider(0.4, range=0..1))  # -> Point, Normal
cp = ControlPoints(Curve=crv_2)  # -> Points, Weights, Knots

cp_2 = ControlPoints(Curve=crv)  # -> Points, Weights, Knots
explode = Explode(Curve=crv, Recursive=True)  # -> Segments, Vertices
len = Length(Curve=explode.Segments)
panel = Panel(cp_2.Points)
ins = InsertItems(List=len, Item="0", Indices="0", Wrap=True)  # -> flatten(List)
ma = MassAddition(Input=ins)  # -> Result, PartialResults
panel_2 = Panel(ma.PartialResults)
pdecon = Deconstruct(Point=flatten(panel))  # -> XComponent, YComponent, ZComponent
multiplication = Multiplication(A="20", B="60")
multiplication_2 = Multiplication(A=panel_2, B="100")
int = Integer(multiplication_2)
claycura_start = Panel("""M109 S20.000000
;Sliced at: Tue 15-12-2020 14:14:58
;Basic settings: Layer height: 2 Walls: 4 Fill: 0
;Print time: 3 hours 20 minutes
;Filament used: 18.308m 1783.0g
;Filament cost: 274.62
;M190 S70 ;Uncomment to add your own bed temperature line
;M109 S20 ;Uncomment to add your own temperature line
G21        ;metric values
G90        ;absolute positioning
M82        ;set extruder to absolute mode
M107       ;start with the fan off
G1 Z2 F9000 ;move the platform down 15mm
G92 E0                  ;zero the extruded length
G1 F200 E3              ;extrude 3mm of feed stock
G92 E0                  ;zero the extruded length again
G1 F9000
;Put printing message on LCD screen
M117 Printing...""")
claycura_end = Panel("""M107
G0 F9000 X179.552 Y103.364 Z286.250
;End GCode
M104 S0                     ;extruder heater off
M140 S0                     ;heated bed heater off (if you have it)
G91                                    ;relative positioning
G1 E-1 F300                            ;retract the filament a bit before lifting the nozzle, to release some of the pressure
G1 Z+0.5 E-5  ;move Z up a bit and retract filament even more
M84                         ;steppers off
G90                         ;absolute positioning
;CURA_PROFILE_STRING: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""")
division = Division(A=int, B="100")
concat = Concatenate(
    FragmentA="G1",
    FragmentB=" F",
    FragmentC=multiplication,
    FragmentD=" X",
    FragmentE=pdecon.XComponent,
    FragmentF=" Y",
    FragmentG=pdecon.YComponent,
    FragmentH=" Z",
    FragmentI=pdecon.ZComponent,
    FragmentJ=" E",
    FragmentK=division)
merge = Merge(Data1=claycura_start, Data2=concat, Data3=claycura_end)
panel_3 = Panel(merge)

iso = IsoCurve(Surface=srf, UVPoint=paramptonsrf.Point)  # -> UIsocurve, VIsocurve
crv_3 = Curve(iso.VIsocurve)
crv_4 = Curve(iso.UIsocurve)
panel_4 = Panel(division)
