# Grasshopper definition MLA_WS_simulation.gh (Grasshopper 1.0.7)

X = Slider(50, range=0..150)
Y = Slider(0, range=0..100)
send_point = Button()
python = GhPythonScript(x=X, y=Y, z=Slider(0, range=0..100), send=send_point)  # -> out, point, a; inputs send: Boolean
# ---------- python: Python ----------
import Rhino.Geometry as rg
from scriptcontext import sticky

if send:
    point = "{0},{1},{2}".format(x, y, z)
    
    sticky["point"] = point
else:
    point = sticky["point"]

a = rg.Point3d(x, y, z)
# ---------- end python ----------
trigger = Trigger(Interval=100, TimerInterval=100, Target=websocket_client_sender)  # disabled
websocket_client_start = WebsocketClientStart(Address="ws://192.168.193.41:8000/ws", InitalMessage=python.point, Reset=Button())
cir = Circle(Plane=python.a, Radius=10)
websocket_client_receiver = WebsocketClientReceiver(WebsocketObjects=websocket_client_start, AutoUpdate=True)  # -> Message, Status
panel = Panel(websocket_client_receiver.Message)
websocket_client_sender = WebsocketClientSender(WebsocketObjects=websocket_client_start, Message=python.point)
python_2 = GhPythonScript(msg=websocket_client_receiver.Message)  # -> out, cvpoints, X, Y, Z
# ---------- python_2: Python ----------
import json
import Rhino.Geometry as rg

cvpoints = []
dict = {}
X = 0
Y = 0
Z = 0

if msg[0] == "<":
    grbl, cv = msg.split("*")
    
    grbl = grbl[1:len(msg)-2]
    grbl_lst = grbl.split("|")
    status = grbl_lst[0]
    dict["wpos"] = grbl_lst[1].split(":")[1].split(",")
    X = float(dict["wpos"][0])
    Y = float(dict["wpos"][1])
    Z = float(dict["wpos"][2])
    
    points = json.loads(cv)
    if points is not None:
        for pt in points:
            cvpoints.append(rg.Point3d(pt[0], pt[1], 0))
        
#    msg = msg[1:len(msg)-2]
#    msg_lst = msg.split("|")
#    status = msg_lst[0]
#    dict["wpos"] = msg_lst[1].split(":")[1].split(",")
#    X = float(dict["wpos"][0])
#    Y = float(dict["wpos"][1])
#    Z = float(dict["wpos"][2])
# ---------- end python_2 ----------
mesh = Mesh(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)
mesh_2 = Mesh(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)
X_2 = UnitX(Factor=python_2.X)
Y_2 = UnitY(Factor=python_2.Y)
panel_2 = Panel(python_2.cvpoints)
move = Move(Geometry=mesh, Motion=X_2)  # -> Geometry, Transform
move_2 = Move(Geometry=mesh_2, Motion=X_2)  # -> Geometry, Transform
move_3 = Move(Geometry=move_2.Geometry, Motion=Y_2)  # -> Geometry, Transform
material = CreateMaterial(Diffuse=RGB(255, 105, 180), Specular=RGB(255, 255, 255), Emission=RGB(0, 0, 0), Transparency=0, Shine=0)
preview = CustomPreview(Geometry=[move.Geometry, move_3.Geometry], Material=ColourSwatch(SwatchColor=RGB(7, 19, 28)))
