# Grasshopper definition WS_ESP32.gh (Grasshopper 1.0.7)

trigger = Trigger(Interval=500, TimerInterval=500, Target=websocket_client_sender)  # disabled
websocket_client_start = WebsocketClientStart(Address="ws://192.168.247.113/ws", InitalMessage="Hello World", Reset=Button())  # disabled
websocket_client_receiver = WebsocketClientReceiver(WebsocketObjects=websocket_client_start, AutoUpdate=True)  # -> Message, Status
websocket_client_sender = WebsocketClientSender(WebsocketObjects=websocket_client_start, Message="test")
panel = Panel(websocket_client_receiver.Message)
