# Grasshopper definition grid_calibration_gcode.gh (Grasshopper 1.0.7)

crv = Curve([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])
disc = Discontinuity(Curve=crv, Level=1)  # -> Points, Parameters
crv_2 = Curve([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])
disc_2 = Discontinuity(Curve=crv_2, Level=1)  # -> Points, Parameters
pdecon = Deconstruct(Point=flatten(disc.Points))  # -> XComponent, YComponent, ZComponent
pdecon_2 = Deconstruct(Point=flatten(disc_2.Points))  # -> XComponent, YComponent, ZComponent
concat = Concatenate(
    FragmentA="G1",
    FragmentB=" F",
    FragmentC="400",
    FragmentD=" X",
    FragmentE=pdecon.XComponent,
    FragmentF=" Y",
    FragmentG=pdecon.YComponent)
concat_2 = Concatenate(
    FragmentA="G1",
    FragmentB=" F",
    FragmentC="400",
    FragmentD=" X",
    FragmentE=pdecon_2.XComponent,
    FragmentF=" Y",
    FragmentG=pdecon_2.YComponent)
python = GhPythonScript(corners=concat, up="M3 S200", down="M5 S200")  # -> out, new_tree; inputs corners: tree
# ---------- python: Python ----------
import ghpythonlib.treehelpers as th

corners = th.tree_to_list(corners)
new_tree = []
squares = []
temp = []

i = 0
for corner in corners:
    temp.append(corner)
    if i == 3:
        new_tree.append(temp[0])
        new_tree.append(down)
        new_tree.append(temp[1])
        new_tree.append(temp[2])
        new_tree.append(temp[3])
        new_tree.append(temp[0])
        new_tree.append(up)
        temp = []
        i = 0
    else:
        i += 1

print new_tree
#new_tree = th.list_to_tree(new_tree, source=[0,0])
# ---------- end python ----------
python_2 = GhPythonScript(corners=concat_2, up="M3 S200", down="M5 S200")  # -> out, new_tree; inputs corners: tree; same code as python
panel = Panel(python.new_tree)
panel_2 = Panel(python_2.new_tree)
