# Grasshopper definition CNC_Simulation.gh (Grasshopper 1.0.7)
# plug-ins: Kangaroo2 Components, Bifocals

srf = Surface(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)
brep = Brep(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)
trigger = Trigger(Interval=1, TimerInterval=5, Target=python)  # disabled
swatch = ColourSwatch(SwatchColor=RGB(206, 245, 88))

# ---- group: Simulation
number_slider = Slider(70, range=0..100)
number_slider_2 = Slider(70, range=0..100)
sdivide = DivideSurface(Surface=srf, UCount=number_slider, VCount=number_slider_2)  # -> Points, Normals, Parameters
pln = Plane(sdivide.Points)
number_slider_3 = Slider(20, range=0..100)
Z = UnitZ(Factor=number_slider_3)

# ----
python = GhPythonScript(state=Toggle(False), limX=number_slider, limY=number_slider_2)  # -> out, a, b; inputs state: Boolean, limX: Int32, limY: Int32
# ---------- python: Python ----------
from scriptcontext import sticky


if not state:
    sticky["valX"] = 0
    sticky["valY"] = 0
else:
    sticky["valY"] += 1
    if sticky["valY"] >= limY:
        sticky["valY"] = 0
        sticky["valX"] += 1

a = sticky["valX"]
b = sticky["valY"]
# ---------- end python ----------

# ---- group: Simulation (continued)
item = ListItem(List=pln, Index=python.b, Wrap=True)
item_2 = ListItem(List=flatten(item), Index=python.a, Wrap=True)
cyl = Cylinder(Base=item_2, Radius=Slider(25, range=0..50), Length=Slider(40, range=0..50))
cyl_2 = Cylinder(Base=item_2, Radius=Slider(3, range=0..10), Length=number_slider_3)
move = Move(Geometry=cyl, Motion=Z)  # -> Geometry, Transform
cap = CapHoles(Brep=cyl_2)
cap_2 = CapHoles(Brep=move.Geometry)
bbx = BrepBrep(BrepA=cap_2, BrepB=brep)  # -> Curves, Points
crv = Curve(bbx.Curves)
patch = Patch(Curves=graft(crv), Spans=20, Flexibility=1, Trim=True)
preview = CustomPreview(
    Geometry=crv,
    Material={diffuse=RGB(221, 160, 221), emission=RGB(66, 48, 66), shine=0.5, specular=RGB(255, 255, 255), transparency=0})
preview_2 = CustomPreview(
    Geometry=patch,
    Material={diffuse=RGB(221, 160, 221), emission=RGB(66, 48, 66), shine=0.5, specular=RGB(255, 255, 255), transparency=0})

# ----
panel = Panel(python.a)
rec = DataRecorder(bbx.Curves, DataLimit=-10, RecordData=False)
panel_2 = Panel(rec)
mp = MultiPipe(
    Curves=flatten(bbx.Curves),
    NodeSize=Slider(2, range=0..10),
    EndOffset=1,
    StrutSize=1,
    Segment=0,
    KinkAngle=0.6,
    CubeFit=0,
    Caps=0)
preview_3 = CustomPreview(Geometry=cap_2, Material=swatch)
preview_4 = CustomPreview(Geometry=cap, Material=swatch)
preview_5 = CustomPreview(Geometry=mp, Material=ColourSwatch(SwatchColor=RGB(255, 69, 69)))
